# Grasshopper definition 1007.gh (Grasshopper 1.0.7)
# plug-ins: BarkBeetle

geodesics_in_u = Curve([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])
srf = Surface(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)
geodesics_in_v = Curve([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])
ccx = CurveCurve(CurveA=graft(geodesics_in_v), CurveB=geodesics_in_u)  # -> simplify(Points), ParamsA, ParamsB
pt = ConstructPoint(XCoordinate=Slider(0.3, range=0..1), YCoordinate=Slider(0.3, range=0..1), ZCoordinate=0)
evalsrf = EvaluateSurface(Surface=reparameterize(srf), Point=pt)  # -> Point, Normal, UDirection, VDirection, Frame
trim = TrimTree(Tree=ccx.Points, Depth=1)
flip = FlipMatrix(Data=trim)
spiral_skeleton = SpiralSkeleton(Surface=srf, PointsTree=flip, StripWidth=Slider(100, range=0..100))  # -> RefinedGeometry, SkeletonPoints
unpack_geo = UnpackGeometryPackage(GeometryPackage=spiral_skeleton.RefinedGeometry)  # -> OrganizedPointTree, ExtendedSurface, SkeletonPoints, SkeletonCurve, UVCurves, UVVectors
toolpath_base = ToolpathBase(RefinedGeometry=spiral_skeleton.RefinedGeometry, SeamPoint=evalsrf.Point, PathWidth=Slider(23, range=0..100))  # -> ToolpathBaseCurve, ToolpathBaseCurves, Pts
pt_2 = Point(toolpath_base.Pts)
crv = Curve(toolpath_base.ToolpathBaseCurves)
item = ListItem(List=unpack_geo.UVVectors, Index=0, Wrap=True)
item_2 = ListItem(List=unpack_geo.UVVectors, Index="1", Wrap=True)
trim_2 = TrimTree(Tree=pt_2, Depth=1)
pt_3 = Point(unpack_geo.OrganizedPointTree)
srf_2 = Surface(unpack_geo.ExtendedSurface)
crv_2 = Curve(unpack_geo.SkeletonCurve)
trim_3 = TrimTree(Tree=item_2, Depth=1)
trim_4 = TrimTree(Tree=item, Depth=1)
trim_5 = TrimTree(Tree=trim_2, Depth=1)
bang = ExplodeTree(Data=trim_5)  # -> Branch0, Branch1, Branch2, Branch3, Branch4, Branch5, Branch6, Branch7, Branch8, Branch9
amp = Amplitude(Vector=trim_3, Amplitude=Slider(100, range=0..100))
amp_2 = Amplitude(Vector=trim_4, Amplitude=Slider(100, range=0..100))
item_3 = ListItem(List=bang.Branch0, Index=0, Wrap=True)
vdis = VectorDisplay(Anchor=pt_3, Vector=amp_2)
vdis_2 = VectorDisplay(Anchor=pt_3, Vector=amp)
