# Grasshopper definition 1016-2.gh (Grasshopper 1.0.7)
# plug-ins: Weaverbird, BarkBeetle, Bifocals

geodesics_in_v = Curve([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])
geodesics_in_u = Curve([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])
curve_curve = CurveCurve(CurveA=graft(geodesics_in_v), CurveB=geodesics_in_u)  # -> simplify(Points), ParamsA, ParamsB
number_slider = Slider(100, range=0..100)
surface = Surface(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)
trim_tree = TrimTree(Tree=curve_curve.Points, Depth=1)
spiral_skeleton = SpiralSkeleton(Surface=surface, PointsTree=trim_tree, StripWidth=number_slider)  # -> SkeletonPackage, SkeletonPoints, SkeletonCurve
unpack_skeleton_package = UnpackSkeletonPackage(SkeletonPackage=spiral_skeleton.SkeletonPackage)  # -> OrganizedPointTree, ExtendedSurface, SkeletonPoints, SkeletonCurve, UVCurves, UVVectors
list_item = ListItem(List=unpack_skeleton_package.UVVectors, Index=0, Wrap=True)
list_item_2 = ListItem(List=unpack_skeleton_package.UVVectors, Index="1", Wrap=True)
number_slider_2 = Slider(100, range=0..100)
point = Point(unpack_skeleton_package.OrganizedPointTree)
trim_tree_2 = TrimTree(Tree=list_item, Depth=1)
trim_tree_3 = TrimTree(Tree=list_item_2, Depth=1)
amplitude = Amplitude(Vector=trim_tree_2, Amplitude=number_slider_2)
amplitude_2 = Amplitude(Vector=trim_tree_3, Amplitude=number_slider_2)
vector_display = VectorDisplay(Anchor=point, Vector=amplitude_2)
vector_display_2 = VectorDisplay(Anchor=point, Vector=amplitude)

number_slider_3 = Slider(75, range=0..100)
brep_strip = BrepStrip(SkeletonPackage=spiral_skeleton.SkeletonPackage, StripExtension=number_slider_3)
brep_strip_2 = BrepStrip(
    StripExtension=number_slider_3,
    Curves=unpack_skeleton_package.UVCurves,
    Surface=unpack_skeleton_package.ExtendedSurface,
    StripWidth=number_slider)

construct_point = ConstructPoint(XCoordinate=Slider(1, range=0..1), YCoordinate=Slider(0, range=0..1), ZCoordinate=0)
number_slider_4 = Slider(30, range=0..100)
evaluate_surface = EvaluateSurface(Surface=reparameterize(surface), Point=construct_point)  # -> Point, Normal, UDirection, VDirection, Frame
spiral_toolpath_base = SpiralToolpathBase(SkeletonPackage=spiral_skeleton.SkeletonPackage, SeamPoint=evaluate_surface.Point, PathWidth=number_slider_4)  # -> ToolpathBase, ToolpathBaseCurve
unpack_toolpath_base = UnpackToolpathBase(OrganizedPointTree=spiral_toolpath_base.ToolpathBase)  # -> SkeletonPackage, ToolpathBaseCurve, UnconnectedCurves, ToolpathPoints
curve = Curve(unpack_toolpath_base.ToolpathBaseCurve)

pi = Pi(Factor=Slider(0.34, range=0..1))
xy_plane = XYPlane(Origin=Point(0, 0, 0))
rotate = Rotate(Geometry=xy_plane, Angle=pi, Plane=PlaneXY(0, 0, 0))  # -> Geometry, Transform
toolpathstackvertical = ToolpathStackVertical(
    ToolpathBase=spiral_toolpath_base.ToolpathBase,
    LayerHeight=Slider(33, range=0..100),
    TotalHeight=Slider(102, range=0..1000),
    OrientOption=Toggle(False),
    ReferencePlane=rotate.Geometry)  # -> ToolpathStack, ToolpathCurve, ToolpathFrames
unpack_toolpath_stack = UnpackToolpathStack(ToolpathStack=toolpathstackvertical.ToolpathStack)  # -> ToolpathBase, ToolpathCurve, ToolpathCurves, ToolpathFrames, SurfaceSeries, SpeedFactors

# ----
# radius should be small!!!
number = Number(number_slider_4)
division = Division(A=number, B="4")
fillet_toolpath_from_toolpathstack = FilletToolpathFromToolpathStack(ToolpathStack=toolpathstackvertical.ToolpathStack, Radius=division, Trigger=Button(), SeamLengthFactor=10)  # -> Curve, ToolpathStack
curve_2 = Curve(fillet_toolpath_from_toolpathstack.Curve)

unpack_toolpath_stack_2 = UnpackToolpathStack(ToolpathStack=fillet_toolpath_from_toolpathstack.ToolpathStack)  # -> ToolpathBase, ToolpathCurve, ToolpathCurves, ToolpathFrames, SurfaceSeries, SpeedFactors
toolpath_mesh = ToolpathMesh(ToolpathStack=fillet_toolpath_from_toolpathstack.ToolpathStack, Parameter=Slider(1, range=0..1))
weaverbird_s_catmull_clark_subdivision = WeaverbirdsCatmullClarkSubdivision(MeshCurves=toolpath_mesh, Level=1, SmoothNakedEdges=1)
custom_preview = CustomPreview(
    Geometry=weaverbird_s_catmull_clark_subdivision,
    Material={diffuse=RGB(221, 160, 221), emission=RGB(66, 48, 66), shine=0.5, specular=RGB(255, 255, 255), transparency=0})
