# Grasshopper definition 1103.gh (Grasshopper 1.0.7)
# plug-ins: Bifocals, BarkBeetle

surface = Surface(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)
# Can deal with UV Surfaces (UV structured points)
# Orthogonal Strips
brep_edges = BrepEdges(Brep=surface)  # -> Naked, Interior, NonManifold
dispatch = Dispatch(List=brep_edges.Naked, DispatchPattern=[True, False])  # -> ListA, ListB
divide_curve = DivideCurve(Curve=dispatch.ListA, Count=Slider(12, range=0..20), Kinks=False)  # -> Points, Tangents, Parameters
divide_curve_2 = DivideCurve(Curve=dispatch.ListB, Count=Slider(6, range=0..10), Kinks=False)  # -> Points, Tangents, Parameters
explode_tree = ExplodeTree(Data=divide_curve.Points)  # -> Branch0, Branch1
explode_tree_2 = ExplodeTree(Data=divide_curve_2.Points)  # -> Branch0, Branch1
reverse_list = ReverseList(List=explode_tree_2.Branch1)
reverse_list_2 = ReverseList(List=explode_tree.Branch1)
geodesic = Geodesic(Surface=surface, Start=explode_tree_2.Branch0, End=reverse_list)
geodesic_2 = Geodesic(Surface=surface, Start=explode_tree.Branch0, End=reverse_list_2)
construct_point = ConstructPoint(XCoordinate=Slider(1, range=0..1), YCoordinate=Slider(0, range=0..1), ZCoordinate=0)
curve_intersection = CurveIntersection(CurvesA=graft(geodesic_2), CurvesB=geodesic, Tolerance=Slider(1, range=0..10))  # -> simplify(IntersectionPoints)
evaluate_surface = EvaluateSurface(Surface=reparameterize(surface), Point=construct_point)  # -> Point, Normal, UDirection, VDirection, Frame

number_slider = Slider(134, range=0..1000)
point = Point(curve_intersection)
surface_2 = Surface(surface)
uv_network_on_surface = UVNetworkOnSurface(Surface=surface_2, PointsTree=point, StripWidth=number_slider)  # -> UVNetwork, Points, UVCurves, ExtendedSrf
spiral_skeleton_graph = SpiralSkeletonGraph(UVNetwork=uv_network_on_surface.UVNetwork)  # -> SkeletonGraph, SkeletonPoints, MainCurve, BranchCurves, Vectors
brep_strip = BrepStrip(
    UVNetwork=uv_network_on_surface.UVNetwork,
    StripExtension=Slider(69, range=0..100),
    Curves=uv_network_on_surface.UVCurves,
    Surface=uv_network_on_surface.ExtendedSrf,
    StripWidth=number_slider)
curve = Curve(spiral_skeleton_graph.MainCurve)
spiral_toolpath_pattern = SpiralToolpathPattern(SkeletonGraph=spiral_skeleton_graph.SkeletonGraph, SeamPoint=Point(0, 0, 0), PathWidth=Slider(30, range=0..100))  # -> ToolpathPattern, Curve
list_item = ListItem(List=curve, Index=Slider(24, range=0..100), Wrap=True)
